# Dynamo custom node KTM.Navisworks.NWCExport.dyf (Dynamo 0.7.5.3566)
# category: KTM.Navisworks
# Exports selected view for NWC

View = Input()
Path = Input()
FileName = Input()
Create_on_Sync = Input()
python_script = Python(IN[0]=View, IN[1]=Path, IN[2]=FileName, IN[3]=Create_on_Sync)
# ---------- python_script.python (52 lines) ----------
# Import RevitAPI
import clr
clr.AddReference("RevitAPI")
import Autodesk
from Autodesk.Revit.DB import *

clr.AddReference("RevitServices")
import RevitServices
from RevitServices.Persistence import DocumentManager
from RevitServices.Transactions import TransactionManager
# Import ToDSType(bool) extension method
clr.AddReference("RevitNodes")
import Revit
clr.ImportExtensions(Revit.Elements)
clr.ImportExtensions(Revit.GeometryConversion)

doc = DocumentManager.Instance.CurrentDBDocument
uiapp = DocumentManager.Instance.CurrentUIApplication
app = uiapp.Application
#The inputs to this node will be stored as a list in the IN variable.
viewExport = IN[0]
pathExport = IN[1]
nwcName = IN[2]
method = IN[3]
b=""

neo = NavisworksExportOptions()
neo.ExportScope = NavisworksExportScope.View
neo.FindMissingMaterials = False
neo.ViewId = UnwrapElement(viewExport).Id

#Validate name
if (nwcName < ""):
	nwcName = doc.Name

#subscribe to save
def OnDocumentSaved(sender,event_args):
	d = event_args.Document
	d.Export(str(pathExport),nwcName,neo)
	b = str(pathExport) + str("\\") + nwcName + ".nwc"

if (method == 0):
	doc.DocumentSaved += OnDocumentSaved
else:
	app.DocumentSynchronizedWithCentral += OnDocumentSaved

output = b
doc.DocumentSaved -= OnDocumentSaved
app.DocumentSynchronizedWithCentral -= OnDocumentSaved

#Assign your output to the OUT variable
OUT = output
# ----------------------------------------
OUT = Output(python_script)
