# Dynamo graph NavisViewExport.dyn (Dynamo 0.7.5.3566)

views = Views("WSHP 2-3 System View")
directory_path = Directory("d:\Users\k.morin.CASE-INC\Desktop")
string = StringInput("Test NWC1")
boolean = BoolSelector(true)
NWCExport = Custom[KTM.Navisworks.NWCExport](View=views, Path=directory_path, FileName=string, Create_on_Sync=boolean)  # Exports selected view for NWC
watch = Watch(NWCExport)
